# Grasshopper definition gh-ground-truth.ghx (Grasshopper 1.0.7)
# plug-ins: Docofossor

inside_edges_of_sandbox = Geometry(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)
sqrt = SquareRoot(Value=Slider(2, range=0..10))
multiplication = Multiplication(A=Slider(256, range=0..1000), B=sqrt)
division = Division(A=multiplication, B=2)
addition = Addition(A=Slider(10, range=0..20), B=division)
# bounds: x: 17 to 1152
# y: -22 to -751
# z: 0 to 130
offset_dist_from_edges = Panel(division)
design = GhPythonScript(offset=addition)  # -> out, c_toolpaths, gh_toolpaths
# ---------- design: Python ----------
import compas_ghpython as cgh
import compas.geometry as cg
import random as r

xmax = 1135
ymin = -737
zmax = 100
#offset = 125
num_crv = 1
length = 50


def generate_toolpaths():
    toolpaths = []
    for i in range(num_crv):
#        x_coord = r.randint(offset, xmax-offset)
#        y_coord = r.randint(ymin+offset, 0-offset)
#        z_coord = 75
        x_coord = 17 + offset
        y_coord = -22 - offset
        z_coord = 50
        pt = cg.Point(x_coord, y_coord, z_coord)
        
        delta = r.random()
        vec = cg.Vector(0, -length, 0)
        
        T = cg.Translation.from_vector(vec)
        pt_end = pt.transformed(T)
        
        pl = cg.Polyline([pt, pt_end])
        toolpaths.append(pl)
    return toolpaths


def draw_toolpaths(c_toolpaths):
    gh_toolpaths = []
    for tp in c_toolpaths:
        artist = cgh.artists.PolylineArtist(tp)
        pl = artist.draw()[0]
        gh_toolpaths.append(pl)
    return gh_toolpaths


c_toolpaths = generate_toolpaths()
gh_toolpaths = draw_toolpaths(c_toolpaths)
# ---------- end design ----------

# ---- group: prediction
depth = Slider(0, range=0..130)
prediction = BooleanToggle(False)
adaptive = BooleanToggle(False)
compas_toolpaths = Data(design.c_toolpaths)

# ---- group: proxy
initiate_proxy = Button()
start_proxy = BooleanToggle(False)
activate = BooleanToggle(False)

# ---- group: save
design_iteration = Panel("0")
export = Button()

# ---- group: scanning
scan = BooleanToggle(False)

# ----
ground_truth = GhPythonScript(
    activate=activate,
    start_proxy=start_proxy,
    initialise_proxy=initiate_proxy,
    scan_sandbox=scan,
    toolpaths=compas_toolpaths,
    prediction=prediction,
    adaptive=adaptive,
    iteration=design_iteration,
    export=export)  # -> out, f, tp; inputs activate: Boolean, start_proxy: Boolean, initialise_proxy: Boolean, scan_sandbox: Boolean, toolpaths: list, prediction: Boolean, adaptive: Boolean, iteration: Int32, export: Boolean
# ---------- ground_truth: Python ----------
from compas_ghpython import unload_modules
from compas_ghpython import artists
unload_modules('groundtruth')
from compas.rpc import Proxy

interface = None

if activate:
    interface = Proxy('groundtruth.interactive.interface')
    if initialise_proxy:
        interface.restart_server()
    if start_proxy:
        interface.start_server()
    else:
        interface.stop_server()
        
        
if interface and start_proxy:
    if scan_sandbox:
        f = interface.scan_sandbox()
    if prediction:
        f, tp = interface.prediction(toolpaths, adaptive)
    if export:
        interface.export_design(tp, iteration)
# ---------- end ground_truth ----------
messages = Panel(ground_truth.out)

# ---- group: height map visualization
dam = DataDam(DataF=ground_truth.f, BufferDelay=10000000, BufferMode=0)
dfimportasc = ImportASC(F=dam)
dfgridmesh = GridMesh(Df=dfimportasc)
coloring_mesh = ColoringMesh(mesh=dfgridmesh)
mesh = Mesh(coloring_mesh)

# ---- group: toolpaths visualization
list = ValueList({"points": 0, "frames": 1, "polyline": 2}, selected="polyline")
dam_2 = DataDam(DataTp=ground_truth.tp, BufferDelay=10000000, BufferMode=0)
tp_visualise = GhPythonScript(tp=dam_2, vis_type=list)  # -> vis; inputs tp: list
# ---------- tp_visualise: Python ----------
import ghpythonlib.treehelpers as th
import Rhino.Geometry as rg
import compas.geometry as cg
from compas_ghpython.artists import PointArtist, FrameArtist, PolylineArtist

def remapValue(v, ori_Min, ori_Max, targetMin, targetMax):
    rv = ((v-ori_Min)/(ori_Max-ori_Min))*(targetMax-targetMin)+targetMin
    return rv

if tp[0] != None:
    frames_tree = []
    pts_tree = []
    pls_list = []
    for t in tp:
        frames_list = []
        pts_list = []
        for f in t:
            f_mirror = f.copy()
            f_mirror.point.y *= (-1)
            # move frame
            framefrom = cg.Frame(cg.Point(0, 0, 0),
                                 cg.Vector.Xaxis(),
                                 cg.Vector.Yaxis())
            frameto = cg.Frame(cg.Point(17,
                                        -22,
                                        0),
                               cg.Vector.Xaxis(),
                               cg.Vector.Yaxis())
            T = cg.Transformation.from_frame_to_frame(framefrom, frameto)
            f_moved = f_mirror.transformed(T)
            # remap z_values
            f_moved.point.z = remapValue(f_moved.point.z, 0, 130, 130, 0)
            # call artist
            artist = FrameArtist(f_moved)
            plane = artist.draw()
            frames_list.append(plane)
            pts_list.append(plane.Origin)
        # frames
        frames_tree.append(frames_list)
        # pts
        pts_tree.append(pts_list)
        # polyline
        pl = rg.Polyline(pts_list)
        pls_list.append(pl)
    
    if vis_type == 0:
        vis = pts_tree
        vis = th.list_to_tree(vis)
    elif vis_type == 1:
        vis = frames_tree
        vis = th.list_to_tree(vis)
    elif vis_type == 2:
        vis = pls_list
# ---------- end tp_visualise ----------
geo = Geometry(tp_visualise)
preview = CustomPreview(Geometry=geo, Material=ColourSwatch(SwatchColor=RGB(0, 64, 255)))

# ==== cluster ColoringMesh
mesh = ClusterInput()
mesh_2 = Mesh(mesh)
demesh = DeconstructMesh(Mesh=mesh_2)  # -> Vertices, Faces, Colours, Normals
pdecon = Deconstruct(Point=demesh.Vertices)  # -> XComponent, YComponent, ZComponent
bnd = Bounds(Numbers=pdecon.ZComponent)
remap = RemapNumbers(Value=pdecon.ZComponent, Source=bnd, Target=Domain(0, 1))  # -> Mapped, Clipped
frgb = ColourRGBF(Alpha=1, Red=remap.Mapped, Green=remap.Mapped, Blue=remap.Mapped)
mcol = MeshColours(Mesh=mesh_2, Colours=frgb)
M = ClusterOutput(mcol)
